# Grasshopper definition parametricSpool.gh (Grasshopper 1.0.8)
# Copyright: MIT License vicdlsns / vdl149

height = Slider(100, range=50..300)
# - All units are the same as your Rhino settings
# - Use sliders to set the dimensions as you wish
# - When finished, click on the "geo" component at the end, right-click it, then "Bake" and "Ok"
# Copyright (c) 2025 vicdlsns/vdl149
# MIT License
# https://github.com/vicdlsns
holediameter = Slider(30, range=10..50)
borderdiameter = Slider(150, range=50..300)
thickness = Slider(3, range=2..5)
cluster = Cluster(holediameter=holediameter, height=height, thickness=thickness, borderdiameter=borderdiameter)
geo = Geometry(cluster)

# ==== cluster Cluster
thickness = ClusterInput()
height = ClusterInput()
holediameter = ClusterInput()
borderdiameter = ClusterInput()

holediameter_2 = Number(holediameter)
borderdiameter_2 = Number(borderdiameter)
thickness_2 = Number(thickness)
height_2 = Number(height)

division = Division(A=borderdiameter_2, B=2)
division_2 = Division(A=holediameter_2, B=2)

# ----
# Middle
addition = Addition(A=division_2, B=thickness_2)
cyl = Cylinder(Base=PlaneXY(0, 0, 0), Radius=addition, Length=height_2)
cap = CapHoles(Brep=cyl)

# ----
# Borders
cyl_2 = Cylinder(Base=PlaneXY(0, 0, 0), Radius=division, Length=thickness_2)
Z = UnitZ(Factor=height_2)
move = Move(Geometry=cyl_2, Motion=Z)  # -> Geometry, Transform
cap_2 = CapHoles(Brep=move.Geometry)
cap_3 = CapHoles(Brep=cyl_2)

# ----
# Hole
addition_2 = Addition(A=height_2, B=thickness_2, C=thickness_2)
cyl_3 = Cylinder(Base=PlaneXY(0, 0, 0), Radius=division_2, Length=addition_2)
cap_4 = CapHoles(Brep=cyl_3)

sunion = SolidUnion(Breps=[cap, cap_3, cap_2])
sdiff = SolidDifference(BrepsA=sunion, BrepsB=cap_4)

R = ClusterOutput(sdiff)
